# Grasshopper definition gh_test_interlock.ghx (Grasshopper 1.0.7)

euler_plane = EulerPlane(angle=Slider(0, range=0..360), angle_2=Slider(144, range=0..360), angle_3=0)
deconstruct_plane = DeconstructPlane(Plane=euler_plane)  # -> Origin, XAxis, YAxis, ZAxis
plane = Plane(euler_plane)
vector = Vector(deconstruct_plane.ZAxis)
vector_display = VectorDisplay(Anchor=deconstruct_plane.Origin, Vector=vector)

euler_plane_2 = EulerPlane(angle=Slider(133, range=0..360), angle_2=Slider(66, range=0..360), angle_3=0)
deconstruct_plane_2 = DeconstructPlane(Plane=euler_plane_2)  # -> Origin, XAxis, YAxis, ZAxis
plane_2 = Plane(euler_plane_2)
vector_2 = Vector(deconstruct_plane_2.ZAxis)
vector_display_2 = VectorDisplay(Anchor=deconstruct_plane_2.Origin, Vector=vector_2)

euler_plane_3 = EulerPlane(angle=Slider(225, range=0..360), angle_2=Slider(204, range=0..360), angle_3=0)
deconstruct_plane_3 = DeconstructPlane(Plane=euler_plane_3)  # -> Origin, XAxis, YAxis, ZAxis
plane_3 = Plane(euler_plane_3)
vector_3 = Vector(deconstruct_plane_3.ZAxis)
vector_display_3 = VectorDisplay(Anchor=deconstruct_plane_3.Origin, Vector=vector_3)

euler_plane_4 = EulerPlane(angle=Slider(21, range=0..360), angle_2=Slider(0, range=0..360), angle_3=0)
deconstruct_plane_4 = DeconstructPlane(Plane=euler_plane_4)  # -> Origin, XAxis, YAxis, ZAxis
plane_4 = Plane(euler_plane_4)
vector_4 = Vector(deconstruct_plane_4.ZAxis)
vector_display_4 = VectorDisplay(Anchor=deconstruct_plane_4.Origin, Vector=vector_4)

euler_plane_5 = EulerPlane(angle=Slider(88, range=0..360), angle_2=Slider(0, range=0..360), angle_3=0)
euler_plane_6 = EulerPlane(angle=Slider(125, range=0..360), angle_2=Slider(51, range=0..360), angle_3=0)
deconstruct_plane_5 = DeconstructPlane(Plane=euler_plane_5)  # -> Origin, XAxis, YAxis, ZAxis
deconstruct_plane_6 = DeconstructPlane(Plane=euler_plane_6)  # -> Origin, XAxis, YAxis, ZAxis
plane_5 = Plane(euler_plane_5)
vector_5 = Vector(deconstruct_plane_5.ZAxis)
plane_6 = Plane(euler_plane_6)
vector_6 = Vector(deconstruct_plane_6.ZAxis)
vector_display_5 = VectorDisplay(Anchor=deconstruct_plane_5.Origin, Vector=vector_5)
vector_display_6 = VectorDisplay(Anchor=deconstruct_plane_6.Origin, Vector=vector_6)

merge = Merge(Data1=vector_6, Data2=vector_5, Data3=vector_4, Data4=vector_3, Data5=vector_2, Data6=vector)
vector_7 = Vector(merge)

# ----
# = True will use compas_rpc;
# = False will use compas_xfunc
# (try comparing the response time of these two methods)
boolean_toggle = BooleanToggle(False)

# ----
# verbose = True will print more info
boolean_toggle_2 = BooleanToggle(False)

cluster = Cluster(z_axis=vector_7, vector=vector_7)  # -> geometry, plane, domain

# ----
# if you made changes on the
# cpython package, click on reconnect
# to make the change available here.
boolean_toggle_3 = BooleanToggle(True)

plane_surface = PlaneSurface(Plane=cluster.plane, XSize=cluster.domain, YSize=cluster.domain)
vector_display_7 = VectorDisplay(Anchor=cluster.geometry, Vector=vector_7)
ghpython_script = GhPythonScript(block_dirs=vector_7, use_rpc=boolean_toggle, reconnect=boolean_toggle_3, verbose=boolean_toggle_2)  # -> out, simplify(feasible_region_rays), linear_index_set; inputs block_dirs: list, reconnect: Boolean, verbose: Boolean
# ---------- ghpython_script: Python ----------
import rhinoscriptsyntax as rs
from ghpythonlib.treehelpers import list_to_tree

if use_rpc:
    from compas.rpc import Proxy
    interlock_util = Proxy('compas_rpc_example.interlock.utils')
else:
    from compas.utilities.xfunc import XFunc

if reconnect:
    interlock_util.stop_server()
    interlock_util.start_server()

def rvector2list(rv):
    return [rv.X, rv.Y, rv.Z]

bdir_lists = [rvector2list(rv) for rv in block_dirs]
#print(bdir_lists)

if use_rpc:
    rays, lin_set = interlock_util.compute_feasible_region_from_block_dir(block_dirs=bdir_lists, verbose=verbose)
else:
    xfunc = XFunc(
    'compas_rpc_example.interlock.utils.compute_feasible_region_from_block_dir')
    xfunc(block_dirs=bdir_lists, verbose=verbose)
    print("error", xfunc.error)
    rays, lin_set = xfunc.data

feasible_region_rays = list_to_tree(rays)
linear_index_set = list_to_tree(lin_set, source=[0,0])
# ---------- end ghpython_script ----------
cluster_2 = Cluster_3(
    list=ghpython_script.feasible_region_rays,
    tree=ghpython_script.feasible_region_rays,
    indices=ghpython_script.linear_index_set)  # -> plane, vector_2, number_slider, colour, surfaces, colour_2
panel = Panel(ghpython_script.out)
vector_display_ex = VectorDisplayEx(Point=cluster_2.plane, Vector=cluster_2.vector_2, Colour=cluster_2.colour, Width=cluster_2.number_slider)
custom_preview = CustomPreview(Geometry=cluster_2.surfaces, Material=cluster_2.colour_2)
panel_2 = Panel(ghpython_script.linear_index_set)

# ==== cluster EulerPlane
xy_plane = XYPlane(Origin=Point(0, 0, 0))
deconstruct_plane = DeconstructPlane(Plane=xy_plane)  # -> Origin, XAxis, YAxis, ZAxis
line_sdl = LineSDL(Start=deconstruct_plane.Origin, Direction=deconstruct_plane.XAxis, Length=1)
angle = ClusterInput()
rotate_axis = RotateAxis(Geometry=xy_plane, Angle=degrees(angle), Axis=line_sdl)  # -> Geometry, Transform
plane = Plane(rotate_axis.Geometry)
deconstruct_plane_2 = DeconstructPlane(Plane=plane)  # -> Origin, XAxis, YAxis, ZAxis
line_sdl_2 = LineSDL(Start=deconstruct_plane_2.Origin, Direction=deconstruct_plane_2.YAxis, Length=1)
angle_2 = ClusterInput()
rotate_axis_2 = RotateAxis(Geometry=plane, Angle=degrees(angle_2), Axis=line_sdl_2)  # -> Geometry, Transform
plane_2 = Plane(rotate_axis_2.Geometry)
deconstruct_plane_3 = DeconstructPlane(Plane=plane_2)  # -> Origin, XAxis, YAxis, ZAxis
line_sdl_3 = LineSDL(Start=deconstruct_plane_3.Origin, Direction=deconstruct_plane_3.ZAxis, Length=1)
angle_3 = ClusterInput()
rotate_axis_3 = RotateAxis(Geometry=plane_2, Angle=degrees(angle_3), Axis=line_sdl_3)  # -> Geometry, Transform
geometry = ClusterOutput(rotate_axis_3.Geometry)

# ==== cluster Cluster
z_axis = ClusterInput()
vector = ClusterInput()
xy_plane = XYPlane(Origin=Point(0, 0, 0))
vector_2 = Vector(unitize(vector))
point = Point(xy_plane)
multiplication = Multiplication(A=vector_2, B=Slider(0.483, range=0..10))
number_slider = Slider(0.632, range=0..1)
move = Move(Geometry=point, Motion=multiplication)  # -> Geometry, Transform
geometry = ClusterOutput(move.Geometry)
negative = Negative(Value=number_slider)
plane_normal = PlaneNormal(Origin=move.Geometry, ZAxis=z_axis)
plane = ClusterOutput(plane_normal)
construct_domain = ConstructDomain(DomainStart=negative, DomainEnd=number_slider)
domain = ClusterOutput(construct_domain)

# ==== cluster Cluster_3
tree = ClusterInput()
indices = ClusterInput()
list = ClusterInput()
construct_path = ConstructPath(Indices=indices)
tree_branch = TreeBranch(Tree=tree, Path=construct_path, MaintainPaths=True)
cluster = Cluster_2(list=tree_branch)
reverse = Reverse(Vector=cluster)
cluster_2 = Cluster_2(list=list)
merge = Merge(Data1=cluster_2, Data2=reverse)
xy_plane = XYPlane(Origin=Point(0, 0, 0))
plane = ClusterOutput(xy_plane)
point = Point(flatten(merge))
vector = Vector(unitize(merge))
vector_2 = ClusterOutput(vector)
number_slider = ClusterOutput(Slider(4, range=0..4))
merge_2 = Merge(Data1=point)
polyline = PolyLine(Vertices=merge_2, Closed=True)
colour_rgb = ColourRGB(Alpha=Slider(186, range=0..255), Red=0, Green=Slider(135, range=0..255), Blue=0)
colour = ClusterOutput(colour_rgb)
boundary_surfaces = BoundarySurfaces(Edges=polyline)
surfaces = ClusterOutput(boundary_surfaces)
colour_rgb_2 = ColourRGB(Alpha=Slider(121, range=0..255), Red=0, Green=Slider(255, range=0..255), Blue=0)
colour_2 = ClusterOutput(colour_rgb_2)

# ==== cluster Cluster_2
list = ClusterInput()
list_item = ListItem(List=list, Index=0, Wrap=True)  # -> Item, Item1, Item2
vector_xyz = VectorXYZ(XComponent=list_item.Item, YComponent=list_item.Item1, ZComponent=list_item.Item2)  # -> flatten(Vector), Length
vector = ClusterOutput(vector_xyz.Vector)
